# Dynamo graph eyup2_model.dyn (Dynamo 2.19.3.6394)
# packages: Elk 1.1.0

# group: OSM
file_path = Filename(".\eyüp2.osm")
location = Elk.OSM.Location(filePath=file_path)

# group: Topography
file_path_2 = Filename(".\n41_e028_1arc_v3.tif")
createTopo = Elk.Topography.CreateTopo(filePath=file_path_2, location=location.Loc)
flatten = List.Flatten(list=createTopo.Points)
byPoints = Topography.ByPoints(points=flatten)

# group: OSM Building
code_block = CodeBlock { "building"; "*"; }
OSMData = Elk.OSM.OSMData(OSM=location.OSM, File=location.XML, featureType=code_block.out0, subTypes=code_block.out1)

# group: Building Footprints
pruneDuplicates = Point.PruneDuplicates(points=OSMData.Points)

# group: Geometry Translate z coordinates
code_block_2 = CodeBlock { 100; }
translate = Geometry.Translate(geometry=pruneDuplicates, zTranslation=code_block_2)

# group: Project
code_block_3 = CodeBlock(buildingspoints=translate) { buildingspoints; }
ZAxis = Vector.ZAxis()
reverse = Vector.Reverse(vector=ZAxis)
code_block_4 = CodeBlock(surfacetopography=createTopo.Surface) { surfacetopography; }
distanceTo = Geometry.DistanceTo(geometry=code_block_3, other=code_block_4)
maximumItem = List.MaximumItem(list=distanceTo)
translate_2 = Geometry.Translate(geometry=code_block_3, direction=reverse, distance=maximumItem)

# group: height random
count = List.Count(list=translate)
code_block_5 = CodeBlock { 3; 21; 3; }
randomList = Math.RandomList(amount=count, value1=code_block_5.out0, value2=code_block_5.out1, seed=code_block_5.out2)

# group: Building Solid
byPoints_2 = Polygon.ByPoints(points=translate_2)
ZAxis_2 = Vector.ZAxis()
extrudeAsSolid = Curve.ExtrudeAsSolid(curve=byPoints_2, direction=ZAxis_2, distance=randomList)

# group: Building 2 Revit
categories = Categories("OST_Mass")
code_block_6 = CodeBlock { "building2"; }
byGeometry = DirectShape.ByGeometry(geometry=extrudeAsSolid, category=categories, name=code_block_6)

# group: roof
roof_types = RoofTypes("Roof_Pitched-50SS-220Ins-20MPan-225Purl")
byGeometry_2 = BoundingBox.ByGeometry(geom=extrudeAsSolid)
maxPoint = BoundingBox.MaxPoint(boundingBox=byGeometry_2)
Z = Point.Z(point=maxPoint)
byElevation = Level.ByElevation(elevation=Z)
byOutlineTypeAndLevel = Roof.ByOutlineTypeAndLevel(outline=byPoints_2, roofType=roof_types, level=byElevation)

# group: TOPO
byPoints_3 = NurbsSurface.ByPoints(points=createTopo.Points)
categories_2 = Categories("OST_Mass")
code_block_7 = CodeBlock { "Eyup2mass"; }
byGeometry_3 = DirectShape.ByGeometry(geometry=byPoints_3, category=categories_2, name=code_block_7)

# group: OSM Natural
code_block_8 = CodeBlock { "natural"; "tree"; }
OSMData_2 = Elk.OSM.OSMData(OSM=location.OSM, File=location.XML, featureType=code_block_8.out0, subTypes=code_block_8.out1)

# group: Geometry Translate z coordinates
code_block_9 = CodeBlock { 100; }
translate_3 = Geometry.Translate(geometry=OSMData_2.Points, zTranslation=code_block_9)

# group: Project
ZAxis_3 = Vector.ZAxis()
reverse_2 = Vector.Reverse(vector=ZAxis_3)
code_block_10 = CodeBlock(surfacetopography=createTopo.Surface) { surfacetopography; }
distanceTo_2 = Geometry.DistanceTo(geometry=translate_3, other=code_block_10)
translate_4 = Geometry.Translate(geometry=translate_3, direction=reverse_2, distance=distanceTo_2)

# group: tree
family_types = FamilyTypes("Mass Tree:Mass Tree")
byPoint = FamilyInstance.ByPoint(familyType=family_types, point=translate_4)
