# Dynamo graph eyup_osm.dyn "eyup_visibility analysis" (Dynamo 2.19.3.6394)
# packages: Elk 1.1.0

# group: OSM
file_path = Filename(".\eyup.large.osm")
location = Elk.OSM.Location(filePath=file_path)

# group: OSM Natural
code_block = CodeBlock { "natural"; "tree"; }  # frozen
OSMData = Elk.OSM.OSMData(OSM=location.OSM, File=location.XML, featureType=code_block.out0, subTypes=code_block.out1)

# group: Geometry Translate z coordinates
code_block_2 = CodeBlock { 100; }
translate = Geometry.Translate(geometry=OSMData.Points, zTranslation=code_block_2)

# group: Topography
file_path_2 = Filename(".\n41_e028_1arc_v3.tif")
createTopo = Elk.Topography.CreateTopo(filePath=file_path_2, location=location.Loc)
flatten = List.Flatten(list=createTopo.Points)
byPoints = Topography.ByPoints(points=flatten)

# group: Project
ZAxis = Vector.ZAxis()
reverse = Vector.Reverse(vector=ZAxis)
code_block_3 = CodeBlock(surfacetopography=createTopo.Surface) { surfacetopography; }
distanceTo = Geometry.DistanceTo(geometry=translate, other=code_block_3)
translate_2 = Geometry.Translate(geometry=translate, direction=reverse, distance=distanceTo)

# group: tree
family_types = FamilyTypes("Planting_RPC_Tree_Deciduous:Red_Ash-7.6_Meters")
byPoint = FamilyInstance.ByPoint(familyType=family_types, point=translate_2)

# group: OSM Building
code_block_4 = CodeBlock { "building"; "*"; }  # frozen
OSMData_2 = Elk.OSM.OSMData(OSM=location.OSM, File=location.XML, featureType=code_block_4.out0, subTypes=code_block_4.out1)

# group: Building Footprints
pruneDuplicates = Point.PruneDuplicates(points=OSMData_2.Points)

# group: Geometry Translate z coordinates
code_block_5 = CodeBlock { 100; }
translate_3 = Geometry.Translate(geometry=pruneDuplicates, zTranslation=code_block_5)

# group: Project
code_block_6 = CodeBlock(buildingspoints=translate_3) { buildingspoints; }
ZAxis_2 = Vector.ZAxis()
reverse_2 = Vector.Reverse(vector=ZAxis_2)
code_block_7 = CodeBlock(surfacetopography=createTopo.Surface) { surfacetopography; }
distanceTo_2 = Geometry.DistanceTo(geometry=code_block_6, other=code_block_7)
maximumItem = List.MaximumItem(list=distanceTo_2)
translate_4 = Geometry.Translate(geometry=code_block_6, direction=reverse_2, distance=maximumItem)

# group: Building Heights
code_block_8 = CodeBlock(keys=OSMData_2.Keys) { keys; }
code_block_9 = CodeBlock { "height:"; }
contains = String.Contains(string=code_block_8, searchFor=code_block_9)
filterByBoolMask = List.FilterByBoolMask(list=code_block_8, mask=contains)
code_block_10 = CodeBlock { ":"; }
split = String.Split(string=filterByBoolMask.in, separator0=code_block_10)
flatten_2 = List.Flatten(list=split)
code_block_11 = CodeBlock { 2; }
takeEveryNthItem = List.TakeEveryNthItem(list=flatten_2, n=code_block_11)

# group: Building Solid
byPoints_2 = Polygon.ByPoints(points=translate_4)
ZAxis_3 = Vector.ZAxis()
toNumber = String.ToNumber(string=takeEveryNthItem)
extrudeAsSolid = Curve.ExtrudeAsSolid(curve=byPoints_2, direction=ZAxis_3, distance=toNumber)

# group: Building 2 Revit
categories = Categories("OST_Mass")
code_block_12 = CodeBlock { "building"; }
byGeometry = DirectShape.ByGeometry(geometry=extrudeAsSolid, category=categories, name=code_block_12)  # frozen

# group: surface
XAxis = Vector.XAxis()
code_block_13 = CodeBlock { 5; }
extrude = Curve.Extrude(direction=XAxis, distance=code_block_13)  # unwired: curve

# group: water 2 Revit
categories_2 = Categories("OST_Mass")
code_block_14 = CodeBlock { "coastline"; }
byGeometry_2 = DirectShape.ByGeometry(geometry=extrude, category=categories_2, name=code_block_14)

# group: OSM water
code_block_15 = CodeBlock { "natural"; "coastline"; }
OSMData_3 = Elk.OSM.OSMData(OSM=location.OSM, File=location.XML, featureType=code_block_15.out0, subTypes=code_block_15.out1)

# group: polycurve
pruneDuplicates_2 = Point.PruneDuplicates(points=OSMData_3.Points)
code_block_16 = CodeBlock { 1; }
byControlPoints = NurbsCurve.ByControlPoints(points=pruneDuplicates_2, degree=code_block_16)

# group: roof
roof_types = RoofTypes("Roof_Pitched-50SS-220Ins-20MPan-225Purl")
byGeometry_3 = BoundingBox.ByGeometry(geom=extrudeAsSolid)
maxPoint = BoundingBox.MaxPoint(boundingBox=byGeometry_3)
Z = Point.Z(point=maxPoint)
byElevation = Level.ByElevation(elevation=Z)
byOutlineTypeAndLevel = Roof.ByOutlineTypeAndLevel(outline=byPoints_2, roofType=roof_types, level=byElevation)  # frozen

# group: OSM water
code_block_17 = CodeBlock { "natural"; "water"; }
OSMData_4 = Elk.OSM.OSMData(OSM=location.OSM, File=location.XML, featureType=code_block_17.out0, subTypes=code_block_17.out1)

# group: polycurve
pruneDuplicates_3 = Point.PruneDuplicates(points=OSMData_4.Points)
code_block_18 = CodeBlock { 1; }
byControlPoints_2 = NurbsCurve.ByControlPoints(points=pruneDuplicates_3, degree=code_block_18)

# group: water 2 Revit
categories_3 = Categories("OST_Mass")
code_block_19 = CodeBlock { "water"; }
byGeometry_4 = DirectShape.ByGeometry(geometry=byControlPoints_2, category=categories_3, name=code_block_19)

# group: surface
XAxis_2 = Vector.XAxis()
code_block_20 = CodeBlock { 5; }
extrude_2 = Curve.Extrude(direction=XAxis_2, distance=code_block_20)  # unwired: curve

# group: Topography 2
file_path_3 = Filename(".\n41_e028_1arc_v3.tif")
code_block_21 = CodeBlock { 28.94408; 28.95184; 41.06429; 41.06200; }
constructLocation = Elk.Topography.ConstructLocation(west=code_block_21.out0, east=code_block_21.out1, south=code_block_21.out3, north=code_block_21.out2)
createTopo_2 = Elk.Topography.CreateTopo(filePath=file_path_3, location=constructLocation)
flatten_3 = List.Flatten(list=createTopo_2.Points)
YAxis = Vector.YAxis()
code_block_22 = CodeBlock { -216.0000; }
translate_5 = Geometry.Translate(geometry=flatten_3, direction=YAxis, distance=code_block_22)
byPoints_3 = Topography.ByPoints(points=translate_5)

# group: Topography 2
file_path_4 = Filename(".\n41_e028_1arc_v3.tif")
code_block_23 = CodeBlock { 28.94408; 28.95184; 41.06893; 41.06990; }
constructLocation_2 = Elk.Topography.ConstructLocation(west=code_block_23.out0, east=code_block_23.out1, south=code_block_23.out2, north=code_block_23.out3)
createTopo_3 = Elk.Topography.CreateTopo(filePath=file_path_4, location=constructLocation_2)
flatten_4 = List.Flatten(list=createTopo_3.Points)
YAxis_2 = Vector.YAxis()
code_block_24 = CodeBlock { 494.0000; }
translate_6 = Geometry.Translate(geometry=flatten_4, direction=YAxis_2, distance=code_block_24)
byPoints_4 = Topography.ByPoints(points=translate_6)

deconstructLocation = Elk.Topography.DeconstructLocation(location=location.Loc)
