# Dynamo graph visual openness.dyn "HESAP visual openness" (Dynamo 2.19.3.6394)
# packages: archi-lab.net 2024.217.1024

# group: Observer Location
select_model_element_bakan_kişi = DSModelElementSelection()  # 1 picked in the model; graph input
location = FamilyInstance.Location(familyInstance=select_model_element_bakan_kişi)
ZAxis = Vector.ZAxis()
number_slider_bakan_kişinin_göz = DoubleSlider(1.7, range=0..100 step 0.1)  # "Number Slider - bakan kişinin göz yüksekliği"; graph input
translate = Geometry.Translate(geometry=location, direction=ZAxis, distance=number_slider_bakan_kişinin_göz)

# group: Spherical Points - latitude longitude lattice
byOrigin = CoordinateSystem.ByOrigin(origin=translate)
number_slider = DoubleSlider(1, range=0..180 step 0.1)
θ_angle_range = CodeBlock(a=number_slider) { 0..180..a; }
number_slider_2 = DoubleSlider(0, range=0..100 step 0.1)
number_slider_3 = DoubleSlider(360, range=0..360 step 0.1)
φ_angle_ranges = CodeBlock(X=number_slider_2, Y=number_slider_3, a=number_slider) { X..Y..a; }
code_block = CodeBlock { -1; }
dropItems = List.DropItems(list=φ_angle_ranges, amount=code_block)
sphere_radius_trim_rays = DoubleSlider(100, range=0..1000 step 0.1)  # graph input
bySphericalCoordinates = Point.BySphericalCoordinates(coordinateSystem=byOrigin, phi=θ_angle_range, theta=dropItems, radius=sphere_radius_trim_rays, lacing=CrossProduct)
flatten = List.Flatten(list=bySphericalCoordinates)

# group: Spherical Points - latitude longitude lattice > maximum number of isovists created
# all the points located on sphere
byStartPointEndPoint = Line.ByStartPointEndPoint(startPoint=translate, endPoint=bySphericalCoordinates, lacing=Longest)

# group: intersection process of isovist to building
direction = Line.Direction(line=byStartPointEndPoint)
number_of_intersection = DoubleSlider(1, range=0..100 step 0.1)
views = Views("{3D}")  # graph input
byOriginDirection = Revit.References.RayBounce.ByOriginDirection(origin=translate, direction=direction, maxBounces=number_of_intersection, view=views, lacing=CrossProduct)

# group: isovists
byStartPointEndPoint_2 = Line.ByStartPointEndPoint(startPoint=translate, endPoint=byOriginDirection.points, lacing=Longest)

# group: getting the distance of isovists that intersected to building
number_slider_4 = DoubleSlider(200, range=0..500 step 0.1)
pointAtChordLength = Curve.PointAtChordLength(curve=byStartPointEndPoint_2, chordLength=number_slider_4)
code_block_2 = CodeBlock(x=number_slider_4) { x+1; }
pointAtChordLength_2 = Curve.PointAtChordLength(curve=byStartPointEndPoint_2, chordLength=code_block_2)
number_slider_5 = DoubleSlider(1, range=0..100 step 0.1)
byPointsRadius = Cone.ByPointsRadius(startPoint=pointAtChordLength, endPoint=pointAtChordLength_2, startRadius=number_slider_5)
trim = Geometry.Trim(geometry=byStartPointEndPoint_2, other=byPointsRadius, pick=pointAtChordLength_2)

# group: isovist length
# null data and unintersected data was deleted
length = Curve.Length(curve=trim, lacing=Longest)
flatten_2 = List.Flatten(list=length)
clear_list = Custom[Clear List](input=flatten_2)  # package archi-lab.net; This node will remove all Null and Empty Lists from any list.

list_count_null_data_intersected = List.Count(list=flatten_2)  # "List.Count - null data + intersected isovists"

# group: elements that was hit by rays
flatten_3 = List.Flatten(list=byOriginDirection.elements)

# group: the number of isovist hit objects
list_count_intersected_isovists = List.Count(list=flatten_3)

# group: the number of all isovist
deleting_duplicate_numbers = Formula("x-y", x=list_count_null_data_intersected, y=list_count_intersected_isovists)

# group: total isovist length/ number of all isovists
math_sum_the_sum_of_the_lengths = Math.Sum(values=clear_list)  # "Math.Sum - the sum of the lengths of isovists intersecting an element"
# note: sum of lengths of isovists that are intersecting and not intersecting isovists
# note: total isovist length/ number of all isovists
function_node = math_sum_the_sum_of_the_lengths / deleting_duplicate_numbers
watch = Watch(function_node)

# group: unintersected isovists
formula = Formula("x-y", x=deleting_duplicate_numbers, y=list_count_intersected_isovists)

# group: Visual Openness -Density: What percentage of the rays hit an object?
# Rays colliding with objects / all rays *100 - the lesser value means the more visual openness
list_count_objelere_keşişen = List.Count(list=clear_list)  # "List.Count - objelere keşişen ışınlar"
çakışanlar_tüm_ışınlar = list_count_objelere_keşişen / deleting_duplicate_numbers
formula_yüzde_değeri = Formula("x*100", x=çakışanlar_tüm_ışınlar)
watch_2 = Watch(formula_yüzde_değeri)

# group: all the points located on sphere
# maximum number of isovists created
byStartPointEndPoint_3 = Line.ByStartPointEndPoint(startPoint=translate, endPoint=bySphericalCoordinates, lacing=Longest)
count = List.Count(list=byStartPointEndPoint_3)
